# Grasshopper definition M3_Design1.gh (Grasshopper 1.0.8)
# plug-ins: LunchBox

twist_angle = Slider(0.656, range=0..62.832)
u_divisions = Slider(3, range=0..100)
v_divisions = Slider(26, range=0..100)

# ----
# Ellipse 1
first_radius = Slider(25, range=0..30)
second_radius = Slider(25, range=0..30)
base_height = Slider(0, range=0..60)
ellipse = Ellipse(Plane=PlaneXY(0, 0, 0), Radius1=first_radius, Radius2=second_radius)  # -> Ellipse, Focus1, Focus2
ellipse_location = VectorXYZ(XComponent=0, YComponent=0, ZComponent=base_height)  # -> Vector, Length
move = Move(Geometry=ellipse.Ellipse, Motion=ellipse_location.Vector)  # -> Geometry, Transform

# ----
# Ellipse 4
first_radius_2 = Slider(25, range=0..30)
second_radius_2 = Slider(25, range=0..30)
ellipse_height = Slider(24, range=0..60)
ellipse_2 = Ellipse(Plane=PlaneXY(0, 0, 0), Radius1=first_radius_2, Radius2=second_radius_2)  # -> Ellipse, Focus1, Focus2
ellipse_location_2 = VectorXYZ(XComponent=0, YComponent=0, ZComponent=ellipse_height)  # -> Vector, Length
move_2 = Move(Geometry=ellipse_2.Ellipse, Motion=ellipse_location_2.Vector)  # -> Geometry, Transform

# ----
# Ellipse 3
first_radius_3 = Slider(30, range=0..30)
second_radius_3 = Slider(30, range=0..30)
distance_from_tabletop = Slider(5, range=0..60)
ellipse_3 = Ellipse(Plane=PlaneXY(0, 0, 0), Radius1=first_radius_3, Radius2=second_radius_3)  # -> Ellipse, Focus1, Focus2
subtraction = Subtraction(A=ellipse_height, B=distance_from_tabletop)
ellipse_location_3 = VectorXYZ(XComponent=0, YComponent=0, ZComponent=subtraction)  # -> Vector, Length
move_3 = Move(Geometry=ellipse_3.Ellipse, Motion=ellipse_location_3.Vector)  # -> Geometry, Transform

# ----
# Ellipse 2
distance_from_base = Slider(5, range=0..60)
second_radius_4 = Slider(30, range=0..30)
first_radius_4 = Slider(30, range=0..30)
addition = Addition(A=base_height, B=distance_from_base)
ellipse_4 = Ellipse(Plane=PlaneXY(0, 0, 0), Radius1=first_radius_4, Radius2=second_radius_4)  # -> Ellipse, Focus1, Focus2
ellipse_location_4 = VectorXYZ(XComponent=0, YComponent=0, ZComponent=addition)  # -> Vector, Length
move_4 = Move(Geometry=ellipse_4.Ellipse, Motion=ellipse_location_4.Vector)  # -> Geometry, Transform

material_thickness = Slider(2.26, range=0..5)

# ----
# Create Cutout for Storage and Tabletop
# As is, this code is intended for table design with a circular tabletop. Not all parameters will play niceley with this storage cuttout code
storage_radius = Slider(48, range=0..60)
storage_depth = Slider(17, range=0..60)
height_of_lip = Subtraction(A=ellipse_height, B=material_thickness)
subtraction_2 = Subtraction(A=second_radius_2, B=storage_radius)
subtraction_3 = Subtraction(A=height_of_lip, B=storage_depth)
vector_xyz = VectorXYZ(XComponent=0, YComponent=0, ZComponent=height_of_lip)  # -> Vector, Length
vector_xyz_2 = VectorXYZ(XComponent=0, YComponent=0, ZComponent=subtraction_3)  # -> Vector, Length
cylinder = Cylinder(Base=PlaneXY(0, 0, 0), Radius=second_radius_2, Length=material_thickness)
cylinder_2 = Cylinder(Base=PlaneXY(0, 0, 0), Radius=subtraction_2, Length=storage_depth)
lip_for_glass_tabletop = Move(Geometry=cylinder, Motion=vector_xyz.Vector)  # -> Geometry, Transform
storage_space = Move(Geometry=cylinder_2, Motion=vector_xyz_2.Vector)  # -> Geometry, Transform
cap_lip = CapHoles(Brep=lip_for_glass_tabletop.Geometry)
cap_storage = CapHoles(Brep=storage_space.Geometry)
solid_union = SolidUnion(Breps=[cap_lip, cap_storage])

# ----
# Create Solid Form
loft = Loft(
    Curves=[move.Geometry, move_4.Geometry, move_3.Geometry, move_2.Geometry],
    Options={Adjust=False, Closed=False, LoftEnds=0, LoftSimp=0, LoftType=0, Rebuild=10, Refit=0.01})
top_face = Area(Geometry=move.Geometry, UseTasks=False)  # -> Area, Centroid
bottom_face = Area(Geometry=move_2.Geometry)  # -> Area, Centroid
diamond_panels = DiamondPanels(Surface=loft, UDivisions=u_divisions, VDivisions=v_divisions)  # -> DiamondPanels, TriPanels
base = Curve(move.Geometry)
tabletop = Curve(move_2.Geometry)
curve = Curve(diamond_panels.TriPanels)
twist_axis = Line(StartPoint=top_face.Centroid, EndPoint=bottom_face.Centroid)
boundary_surfaces = BoundarySurfaces(Edges=[tabletop, base, curve])
twist = Twist(
    Geometry=[boundary_surfaces, diamond_panels.DiamondPanels],
    Axis=twist_axis,
    Angle=twist_angle,
    Infinite=False,
    Rigid=False)

# ----
# Remove Storage Space
solid_difference = SolidDifference(BrepsA=twist, BrepsB=solid_union)
